test file "sensors"

suite "Sensor Tests"

  case "ins" [baseline]
    model ins, harness insTestHarness
    test sequence scenario: Scenario_1 (insTestHarness/Test Sequence)
    iterations:
      Iteration1: TestSequenceScenario "Scenario_1"

  case "adc" [baseline]
    model adc, harness adcTestHarness
    test sequence scenario: Scenario_1 (adcTestHarness/Test Sequence)
    iterations:
      Iteration1: TestSequenceScenario "Scenario_1"

  case "gps" [baseline]
    model gps, harness gpsTestHarness
    test sequence scenario: Scenario_1 (gpsTestHarness/Test Sequence)
    iterations:
      Iteration1: TestSequenceScenario "Scenario_1"

  case "sensors" [baseline]
    model sensors, harness sensorsTestHarness
    test sequence scenario: Scenario_1 (sensorsTestHarness/Test Sequence)
    iterations:
      Iteration1: TestSequenceScenario "Scenario_1"