test file "hexarotor"

suite "Vehicle Tests"

  case "hexAero" [baseline]
    model hexAero, harness hexAeroTestHarness
    test sequence scenario: Scenario_1 (hexAeroTestHarness/Test Sequence1)

  case "hexAddFM" [baseline]
    model hexAddFm, harness hexAddFmTestHarness
    test sequence scenario: Scenario_1 (hexAddFmTestHarness/Test Sequence1)

  case "hexGroundContact" [baseline]
    model hexGroundContact, harness hexGroundContactTestHarness
    test sequence scenario: Scenario_1 (hexGroundContactTestHarness/Test Sequence)

  case "hexMotorModel" [baseline]
    model hexMotorModel, harness hexMotorModelTestHarness
    test sequence scenario: Hexarotor (hexMotorModelTestHarness/Test Sequence1)

  case "hexAeroCoefficientsModel" [baseline]
    model hexAeroCoefficientsModel, harness hexAeroCoefficientsModelTestHarness
    test sequence scenario: Scenario_1 (hexAeroCoefficientsModelTestHarness/Test Sequence)